# Dynamo graph Demo.dyn (Dynamo 2.1.0.7500)

# group: All lines on the same level
views = Views("Level 1")

all_elements_in_views = Python(IN[0]=views)
# ---------- all_elements_in_views.python (17 lines) ----------
#Copyright (c) mostafa el ayoubi
#Data-Shapes 2016 elayoub.mostafa@gmail.com

import clr
clr.AddReference('RevitAPI')
from Autodesk.Revit.DB import*
clr.AddReference('RevitServices')
from RevitServices.Persistence import DocumentManager

doc = DocumentManager.Instance.CurrentDBDocument

if isinstance(IN[0],list):
	views = UnwrapElement(IN[0])
else:
	views = [UnwrapElement(IN[0])]

OUT = [FilteredElementCollector(doc,v.Id).ToElements() for v in views]
# ----------------------------------------

# group (continued): All lines on the same level
flatten = List.Flatten(list=all_elements_in_views)

# group: Lines with COLUMN type
code_block = CodeBlock { "COLUMN"; }
code_block_2 = CodeBlock(LineStyleName=code_block) { LineStyleName:string; }
python_script = Python(IN[0]=code_block_2)
# ---------- python_script.python (26 lines) ----------
#Copyright (c) mostafa el ayoubi
#Data-Shapes 2016 elayoub.mostafa@gmail.com

import clr
clr.AddReference('RevitServices')
import RevitServices
from RevitServices.Persistence import DocumentManager
clr.AddReference('RevitAPI')
from Autodesk.Revit.DB import *


doc = DocumentManager.Instance.CurrentDBDocument

if isinstance(IN[0],list):
	names = UnwrapElement(IN[0])
else:
	names = [UnwrapElement(IN[0])]
	
alllines = FilteredElementCollector(doc).OfCategory(BuiltInCategory.OST_Lines)

lines = []

for n in names:
	lines.append([x for x in alllines if x.LineStyle.Name == n ])

OUT = lines
# ----------------------------------------
flatten_2 = List.Flatten(list=python_script)
setIntersection = List.SetIntersection(list1=flatten_2, list2=flatten)
curves = Element.Curves(element=setIntersection)
flatten_3 = List.Flatten(list=curves)

column_basepoints = Python(IN[0]=flatten_3)
# ---------- column_basepoints.python (17 lines) ----------
# Load the Python Standard and DesignScript Libraries
import clr
clr.AddReference('ProtoGeometry')
from Autodesk.DesignScript.Geometry import *

# Group base-points of columns into ptslist
lines = IN[0]
ptslist = []

for line1 in lines:
	pts = []
	for line2 in lines:
		if Geometry.DistanceTo(line1, line2) <= 800:
			pts.append(line2.StartPoint)
	ptslist.append(pts)

OUT = ptslist
# ----------------------------------------
uniqueItems = List.UniqueItems(list=column_basepoints)
axis_generate = Python(IN[0]=uniqueItems)
# ---------- axis_generate.python (23 lines) ----------
# Load the Python Standard and DesignScript Libraries
import sys
import clr
clr.AddReference('ProtoGeometry')
from Autodesk.DesignScript.Geometry import *

### ianqu | Column axis generation | Dummy version
ptslist = IN[0]

column_axes = []
column_height = 3000

for pts in ptslist:
	sum_X, sum_Y = 0, 0
	for pt in pts:
		sum_X += pt.X
		sum_Y += pt.Y
	start = Point.ByCoordinates(sum_X/4, sum_Y/4, 0)
	end = Point.ByCoordinates(sum_X/4, sum_Y/4, column_height)
	axis = Line.ByStartPointEndPoint(start, end)
	column_axes.append(axis)

OUT = column_axes
# ----------------------------------------
levels = Levels("Level 1")
structural_column_types = StructuralColumnTypes("Column_demo")
columnByCurve = StructuralFraming.ColumnByCurve(curve=axis_generate, level=levels, structuralColumnType=structural_column_types)

# group: Lines with WALL type
code_block_3 = CodeBlock { "WALL"; }
# note: Data-Shapes.AllElementInViews
code_block_4 = CodeBlock(LineStyleName=code_block_3) { LineStyleName : string; }
python_script_2 = Python(IN[0]=code_block_4)  # same code as python_script
flatten_4 = List.Flatten(list=python_script_2)
setIntersection_2 = List.SetIntersection(list1=flatten_4, list2=flatten)
# note: Here, from model element in Revit to parametric represented stuff in Dynamo
curves_2 = Element.Curves(element=setIntersection_2)
flatten_5 = List.Flatten(list=curves_2)

parallel_bundle = Python(IN[0]=flatten_5)
# ---------- parallel_bundle.python (42 lines) ----------
# Load the Python Standard and DesignScript Libraries
import sys
import clr
clr.AddReference('ProtoGeometry')
from Autodesk.DesignScript.Geometry import *

# The inputs to this node will be stored as a list in the IN variables.
lines = IN[0]
bias = 1


def iscrossed(line1, line2):
	threshold = 41000
	# Note that the line equals line segment in Dynamo
	line1_ext = Curve.ExtendEnd(Curve.ExtendStart(line1, threshold), threshold)
	line2_ext = Curve.ExtendEnd(Curve.ExtendStart(line2, threshold), threshold)
	if line1_ext.DoesIntersect(line2_ext):
		return True
	else:
		return False

# Check if two lines are parallel
def isparallel(line1, line2):
	vec1 = line1.Direction
	vec2 = line2.Direction
	angle = Vector.AngleWithVector(vec1, vec2)
	if angle == 0 or angle == 180:
		return True
	else:
		return False


bundles = []
for i in range(len(lines)):
	for j in range(len(lines) - i):
		if isparallel(lines[i], lines[i+j]):
			if not iscrossed(lines[i], lines[i+j]):
				# Note that the default thickness of wall is 200mm
				if 200-bias < Geometry.DistanceTo(lines[i], lines[i+j]) < 200+bias:
					bundles.append([lines[i], lines[i+j]])

OUT = bundles
# ----------------------------------------
axis_generation = Python(IN[0]=parallel_bundle)
# ---------- axis_generation.python (33 lines) ----------
# Load the Python Standard and DesignScript Libraries
import sys
import clr
clr.AddReference('ProtoGeometry')
from Autodesk.DesignScript.Geometry import *

# The inputs to this node will be stored as a list in the IN variables.
bundles = IN[0]
axes = []

# Dummy version
def genaxis(line1, line2):
	walk = Geometry.DistanceTo(line1, line2)
	if line1.Length > line2.Length:
		start = line1
		end = line2
	else:
		start = line2
		end = line1
	shadow1 = Geometry.Translate(start, Curve.NormalAtParameter(start, 0.5), walk/2)
	shadow2 = Geometry.Translate(start, Vector.Reverse(Curve.NormalAtParameter(start, 0.5)), walk/2)
	if Geometry.DistanceTo(shadow1, end) < walk:
		return shadow1
	else:
		return shadow2
	
for bundle in bundles:
	try:
		axes.append(genaxis(bundle[0], bundle[1]))
	except:
		axes.append(None)

OUT = axes
# ----------------------------------------
# note: Chynamo.Line.GroupByParallel
group_by_parallel = Python(IN[0]=axis_generation)
# ---------- group_by_parallel.python (29 lines) ----------
# Load the Python Standard and DesignScript Libraries
import sys
import clr
clr.AddReference('ProtoGeometry')
from Autodesk.DesignScript.Geometry import *

### ianqu | GroupLinesByParallel
# This is to replace Chynamo.Line.GroupByParallel with the same function
# for embedded in C#
lines = IN[0]

axis_X = Vector.ByCoordinates(1,0,0)

directions = []
linesgroup = []

for line in lines:
	vec = Vector.Normalized(line.Direction)
	if vec in directions or Vector.Reverse(vec) in directions:
		try:
			index = directions.index(vec)
		except:
			index = directions.index(Vector.Reverse(vec))
		linesgroup[index].append(line)
	else:
		directions.append(vec)
		linesgroup.append([line])

OUT = linesgroup
# ----------------------------------------
# note: Chynamo.Line.GroupByIntersect
groupByIntersect = Custom[Curve.GroupByIntersect](curves=group_by_parallel)  # Group the curves if they are intersected
code_block_5 = CodeBlock { 1; }
flatten_6 = List.Flatten(list=groupByIntersect, amt=code_block_5)
uniqueItems_2 = List.UniqueItems(list=flatten_6)
axis_merge = Python(IN[0]=uniqueItems_2)
# ---------- axis_merge.python (48 lines) ----------
# Load the Python Standard and DesignScript Libraries
import sys
import clr
clr.AddReference('ProtoGeometry')
from Autodesk.DesignScript.Geometry import *

# The inputs to this node will be stored as a list in the IN variables.
lists = IN[0]

# Updated bubble sorting to align points from left-bottom to the up-right
# Picking up geometry coordinates may have bias on the last digits of the number
# Add threshold to avoid this sorting failure
def bubbleSort(arr):
	threshold = 0.1
	n = len(arr)
	for i in range(n):
		for j in range(0, n-i-1):
			if arr[j].X > arr[j+1].X + threshold:
				arr[j], arr[j+1] = arr[j+1], arr[j]
                
	for i in range(n):
 		for j in range(0, n-i-1):
			if arr[j].Y > arr[j+1].Y + threshold:
				arr[j], arr[j+1] = arr[j+1], arr[j]

# Try to weld overlapping axes
def mergeline(list):
	ptspool = []
	for line in list:
		ptspool.append(line.StartPoint)
		ptspool.append(line.EndPoint)
	bubbleSort(ptspool)
	try:
		merged = Line.ByStartPointEndPoint(ptspool[0], ptspool[-1])
		return merged
	except:
		return False

redraw = []
for list in lists:
	if len(list) == 0:
		continue
	elif len(list) == 1:
		redraw.append(list[0])
	elif mergeline(list):
		redraw.append(mergeline(list))

OUT = redraw
# ----------------------------------------
uniqueItems_3 = List.UniqueItems(list=axis_merge)
line_to_curve = Python(IN[0]=uniqueItems_3)
# ---------- line_to_curve.python (13 lines) ----------
# Load the Python Standard and DesignScript Libraries
import sys
import clr
clr.AddReference('ProtoGeometry')
from Autodesk.DesignScript.Geometry import *

# Dynamo is way too dumber than Grasshopper concerning with the Element Type conversion
lines = IN[0]
curves = []
for line in lines:
	if Curve.Offset(line, 0):
		curves.append(Curve.Offset(line, 0))
OUT = curves
# ----------------------------------------
levels_2 = Levels("Level 1")
levels_3 = Levels("Level 2")
wall_types = WallTypes("Generic - 200mm")
byCurveAndLevels = Wall.ByCurveAndLevels(c=line_to_curve, startLevel=levels_2, endLevel=levels_3, wallType=wall_types)
